# Dynamo graph QA,QC Electrical Fixtures.dyn (Dynamo 1.3.4.6666)

# group: <PROJECT NO.> <PROJECT NAME>
# note: CREATED BY: <Sophy Li>
# CREATED: <2019/03/19>
# VERSION <0.1>
# LAST EDITED: <2019/03/26>
# DYNAMO VERSION: <Dynamo 1.3.2>
# PACKAGES:
# <PACKAGES>
# Clockwork 1.33.1
# Bakery 2018.4.301
# NOTES:
# <NOTES>

# group: DESIGNER'S GUIDELINES
# note: DESIGNER'S GUIDELINES
# 1. DIVIDE THE DYNAMO DEFINITION INTO THE USER INTERFACE AND THE BACK-END
# 2. BUILD THE DEFINITION WITH SMALL BLOCKS
# 3. BLOCKS SHOULD ALWAYS HAVE INPUT/OUTPUT
# 4. RENAME INPUT/OUTPUT CONTAINERS TO DATA THEY CARRY
# 5. COLOR-CODE BLOCKS ACCORDING TO THE TEMPLATE

# group: User Interface
code_block = CodeBlock { "User Interface"; }

# group: Input Data
code_block_2 = CodeBlock(b=code_block) { b - "Retrive Data"; }

# group: Process Data
code_block_3 = CodeBlock(c=code_block_2) { c - "Process Data"; }

# group: Write Data
code_block_4 = CodeBlock(d=code_block_3) { d - "Write Data"; }

# group: Lookup Data
code_block_5 = CodeBlock(c=code_block_3, d=code_block_2) { c - "Lookup Data"; d - "Lookup Data"; }

# group: Get element of category
categories = Categories("ElectricalFixtures")
all_elements_of_category = ElementsOfCategory(categories)

# group: Show all instance parameters
code_block_6 = CodeBlock(x=all_elements_of_category) { x[0]; }
parameters = Element.Parameters(code_block_6)
watch = Watch(parameters)

# group: Get element of category
categories_2 = Categories("ElectricalCircuit")
all_elements_of_category_2 = ElementsOfCategory(categories_2)

# group: Show all instance parameters
code_block_7 = CodeBlock(x=all_elements_of_category_2) { x[0]; }
parameters_2 = Element.Parameters(code_block_7)
watch_2 = Watch(parameters_2)

# group: Get parameters from elements
code_block_8 = CodeBlock { "Family"; "Type"; "Panel"; "Circuit Number"; }
getParameterValueByName = Element.GetParameterValueByName(element=all_elements_of_category, parameterName=code_block_8.out0)
family = FamilyType.Family(getParameterValueByName)
name = Family.Name(family)
getParameterValueByName_2 = Element.GetParameterValueByName(element=all_elements_of_category, parameterName=code_block_8.out1)
name_2 = FamilyType.Name(getParameterValueByName_2)
getParameterValueByName_3 = Element.GetParameterValueByName(element=all_elements_of_category, parameterName=code_block_8.out2)
getParameterValueByName_4 = Element.GetParameterValueByName(element=all_elements_of_category, parameterName=code_block_8.out3)

# group: Merge data inputs, create list, transpose list
code_block_9 = CodeBlock(x=name, y=name_2) { x + " | "+y; }
code_block_10 = CodeBlock(x=getParameterValueByName_3, y=getParameterValueByName_4) { x + " | "+y; }
groupByKey = List.GroupByKey(list=code_block_9, keys=code_block_10)
watch_3 = Watch(groupByKey.groups)
watch_4 = Watch(groupByKey.unique_keys)

# group: Get parameters from elements
code_block_11 = CodeBlock(x=all_elements_of_category_2) { x; }
code_block_12 = CodeBlock { "Panel"; "Circuit Number"; "Rating"; }
getParameterValueByName_5 = Element.GetParameterValueByName(element=code_block_11, parameterName=code_block_12.out0)
getParameterValueByName_6 = Element.GetParameterValueByName(element=code_block_11, parameterName=code_block_12.out1)
getParameterValueByName_7 = Element.GetParameterValueByName(element=code_block_11, parameterName=code_block_12.out2)

# group: Merge data inputs, create list, transpose list
code_block_13 = CodeBlock(x=getParameterValueByName_5, y=getParameterValueByName_6) { x + " | "+y; }
create = List.Create(code_block_13, getParameterValueByName_7)
transpose = List.Transpose(create)
watch_5 = Watch(transpose)
watch_6 = Watch(create)

# group: Write Circuit Info
file_path = Filename("..\Test\test.xlsx")  # frozen
code_block_14 = CodeBlock { "Circuits"; 0; 0; true; }
writeToFile = Excel.WriteToFile(filePath=file_path, sheetName=code_block_14.out0, startRow=code_block_14.out1, startCol=code_block_14.out2, data=transpose, overWrite=code_block_14.out3)

categories_3 = Categories("Schedules")
all_elements_of_category_3 = ElementsOfCategory(categories_3)
filter = List.Filter(all_elements_of_category_3)  # unwired: arg1
watch_7 = Watch(filter.out1)
string = StringInput("Electrical Fixture Schedule")
code_block_15 = CodeBlock(x=transpose) { x; }
code_block_16 = CodeBlock(y=groupByKey.unique_keys) { y; }

# group: Find boolean list of matching values from two lists
code_block_17 = CodeBlock { 0; }
getItemAtIndex = List.GetItemAtIndex(index=code_block_17)  # unwired: list
map = List.Map(list=code_block_15, f_x=getItemAtIndex)
containsItem = List.ContainsItem(list=code_block_16, item=map)
filterByBoolMask = List.FilterByBoolMask(list=map, mask=containsItem)

# group: Return index value from true
boolean = BoolSelector(true)
allIndicesOf = List.AllIndicesOf(list=containsItem, item=boolean)
getItemAtIndex_2 = List.GetItemAtIndex(list=code_block_15, index=allIndicesOf)

code_block_18 = CodeBlock(z=name) { z; }

# group: Find Panel/ Circuit info for special equipment
code_block_19 = CodeBlock { "M_Duplex Receptacle"; }
containsItem_2 = List.ContainsItem(item=code_block_19)  # unwired: list
map_2 = List.Map(list=code_block_18, f_x=containsItem_2)
boolean_2 = BoolSelector(true)
allIndicesOf_2 = List.AllIndicesOf(list=map_2, item=boolean_2)
getItemAtIndex_3 = List.GetItemAtIndex(list=code_block_10, index=allIndicesOf_2)
code_block_20 = CodeBlock { " | "; }
eq = _ == code_block_20  # unwired: arg0
map_3 = List.Map(list=getItemAtIndex_3, f_x=eq)
boolean_3 = BoolSelector(false)
allIndicesOf_3 = List.AllIndicesOf(list=map_3, item=boolean_3)
getItemAtIndex_4 = List.GetItemAtIndex(list=getItemAtIndex_3, index=allIndicesOf_3)
unique_item_selector = Custom[Unique Item Selector](items=getItemAtIndex_4)
watch_8 = Watch(getItemAtIndex_3)
watch_9 = Watch(unique_item_selector.uniqueItems)

# group: Change rating based on family type
code_block_21 = CodeBlock(x=getItemAtIndex_2, y=unique_item_selector.uniqueItems) { x; y; }
transpose_2 = List.Transpose(code_block_21.x)
code_block_22 = CodeBlock(x=transpose_2) { x[0]; x[1]; }
indexOf = IndexOf(code_block_22.out0)  # unwired: arg1
map_4 = List.Map(list=code_block_21.y, f_x=indexOf)
code_block_23 = CodeBlock { 25; }
replaceItemAtIndex = Custom[List.ReplaceItemAtIndex+](seq=code_block_22.out1, indices=map_4, replacement=code_block_23)  # Replaces the item at a given index of a list by another item. Unlike the OOTB node, it can replace items at multiple indeces.
create_2 = List.Create(code_block_22.out0, replaceItemAtIndex)
transpose_3 = List.Transpose(create_2)

# group: Write Comparison Info
file_path_2 = Filename("..\Test\test.xlsx")  # frozen
code_block_24 = CodeBlock { "Compare"; 0; 0; true; }
string_from_object = FromObject()  # unwired: arg0
map_5 = List.Map(list=transpose_3, f_x=string_from_object)
writeToFile_2 = Excel.WriteToFile(filePath=file_path_2, sheetName=code_block_24.out0, startRow=code_block_24.out1, startCol=code_block_24.out2, data=map_5, overWrite=code_block_24.out3)
