# Dynamo graph Smoke Detector Quality Assurance.dyn (Dynamo 1.3.4.6666)

# group: Get Information for 'Fire Alarm Devices' and Filter for Smoke Detectors
# note: 1. Retrieve all elements from the "Fire Alarm Devices" category in Revit.
categories = Categories("FireAlarmDevices")
all_elements_of_category = ElementsOfCategory(categories)
name = Element.Name(all_elements_of_category)
# note: 2. Search for "Smoke Detector" (case sensitive). Display results in a Boolean list.
code_block = CodeBlock { "Smoke Detector"; }
# note: 3. Filter for smoke detector instances.
containsItem = List.ContainsItem(list=name, item=code_block, lacing=Longest)
filterByBoolMask = List.FilterByBoolMask(list=all_elements_of_category, mask=containsItem)

# group: Element Parameters
code_block_2 = CodeBlock(x=filterByBoolMask.in) { x[0]; }
parameters = Element.Parameters(code_block_2)
watch = Watch(parameters)

# group: Get 'Air Terminals'
categories_2 = Categories("DuctTerminal")
all_elements_of_category_2 = ElementsOfCategory(categories_2)

# group: Element Parameters
code_block_3 = CodeBlock(x=all_elements_of_category_2) { x[0]; }
parameters_2 = Element.Parameters(code_block_3)
watch_2 = Watch(parameters_2)

# group: Filter by Reference Plane (z-axis)
# note: 1. Get host (reference plane) of each smoke detector.
get_host_element = Custom[Get Host Element [archilab]](hostedElement=filterByBoolMask.in)  # This node will retrieve a host element from hosted element. Ex. feed in door, get wall.
name_2 = Element.Name(get_host_element)
# note: 2. Filter host by name.
code_block_4 = CodeBlock { "L1-2600mm"; }
containsItem_2 = List.ContainsItem(list=name_2, item=code_block_4, lacing=Longest)
# note: 3. Get indices of matching reference planes in the master list.
# note: 4. Retrieve elements from the list at the specified indices.
boolean = BoolSelector(true)
allIndicesOf = List.AllIndicesOf(list=containsItem_2, item=boolean)
getItemAtIndex = List.GetItemAtIndex(list=filterByBoolMask.in, index=allIndicesOf)
watch_3 = Watch(getItemAtIndex)

code_block_5 = CodeBlock(x=watch_3) { x; }

# group: Filter by Reference Plane (z-axis)
get_host_element_2 = Custom[Get Host Element [archilab]](hostedElement=all_elements_of_category_2)
name_3 = Element.Name(get_host_element_2)
code_block_6 = CodeBlock { "L1-2600mm"; }
containsItem_3 = List.ContainsItem(list=name_3, item=code_block_6, lacing=Longest)
boolean_2 = BoolSelector(true)
allIndicesOf_2 = List.AllIndicesOf(list=containsItem_3, item=boolean_2)
getItemAtIndex_2 = List.GetItemAtIndex(list=all_elements_of_category_2, index=allIndicesOf_2)
watch_4 = Watch(getItemAtIndex_2)

# group: Find center coordinates (x,y) for all air terminals
location = Custom[Element.Location+ [Clockwork]](element=watch_4)  # "Element.Location+"; Returns the location of an element as an XYZ (or if it's line-based the start and end point of the line), along with some booleans to help filtering the results. Use this for some element types (e.g. walls or lines) that do not work with the built-in Get Family Instance Location node.
X = ReferencePoint.X(location.points)
# note: Find center coordinates (x,y) for all air terminals.
Y = ReferencePoint.Y(location.points)

# group: User select square diffuser dimension
integer_slider = IntegerSlider(600, range=0..1000 step 100)
code_block_7 = CodeBlock { 2; }
div = integer_slider / code_block_7
code_block_8 = CodeBlock(x=div) { x; }
div_2 = div / code_block_7

# group: Find corners and center points along perimeter of diffuser - using simple geometry
code_block_9 = CodeBlock(x=X) { x; }
add = X + code_block_8
sub = X - code_block_8
sub_2 = code_block_9 - div_2
add_2 = code_block_9 + div_2
create = List.Create(code_block_9, add, add, add, code_block_9, sub, sub, sub, code_block_9, sub_2, add_2, add, add, add_2, sub_2, sub, sub)
watch_5 = Watch(create)
flatten = Flatten(watch_5)
add_3 = Y + code_block_8
code_block_10 = CodeBlock(y=Y) { y; }
sub_3 = Y - code_block_8
add_4 = code_block_10 + div_2
sub_4 = code_block_10 - div_2
create_2 = List.Create(add_3, add_3, code_block_10, sub_3, sub_3, sub_3, code_block_10, add_3, code_block_10, add_3, add_3, add_4, sub_4, sub_3, sub_3, sub_4, add_4)
watch_6 = Watch(create_2)
flatten_2 = Flatten(watch_6)

# group: Find center coordinates (x,y) of all smoke detectors
location_2 = Custom[Element.Location+ [Clockwork]](element=watch_3)  # "Element.Location+"
X_2 = ReferencePoint.X(location_2.points)
Y_2 = ReferencePoint.Y(location_2.points)

# group: Check if the center of air diffusers lies within 450 mm from the perimeter of smoke detectors. Use circle formula.
sub_5 = flatten - X_2  # lacing=CrossProduct
# note: 1. Find difference of x and y coordinates between diffusers and smoke detectors.
sub_6 = flatten_2 - Y_2  # lacing=CrossProduct
code_block_11 = CodeBlock(x=sub_5, y=sub_6) { x; y; }
mul = code_block_11.x * code_block_11.x
mul_2 = code_block_11.y * code_block_11.y
add_5 = mul + mul_2
# note: 2. Square differences.
code_block_12 = CodeBlock { 390625; }
lt = add_5 < code_block_12
# note: 3. Check if distance  < 450*450.
boolean_3 = BoolSelector(true)

# group: Find Uniqiue Lists of Smoke Detectors
allIndicesOf_3 = List.AllIndicesOf(list=lt, item=boolean_3, lacing=Longest)
getItemAtIndex_3 = List.GetItemAtIndex(list=code_block_5, index=allIndicesOf_3)
# note: 2. Filter for a list of unique items.
# note: 1. Remove empty lists.
code_block_13 = CodeBlock { 1; }
flatten_3 = List.Flatten(list=getItemAtIndex_3, amt=code_block_13)
uniqueItems = List.UniqueItems(flatten_3)

# group: Bool-mask Reset Smoke Detector Color
# note: 1. Filters original smoke detector list into two. The first list contains unregulated smoke detectors and the second list contains regulated smoke detectors.
containsItem_4 = List.ContainsItem(list=uniqueItems, item=code_block_5)
filterByBoolMask_2 = List.FilterByBoolMask(list=code_block_5, mask=containsItem_4)

# group: Change Unregulated Smoke Detectors Red
red = Custom[Color.Red [Clockwork]]()  # "Color.Red"; Returns the colour red.
boolean_4 = BoolSelector(false)
byProperties = Revit.Filter.OverrideGraphicSettings.ByProperties(arg1=red, arg3=red, arg12=boolean_4)
overrideInView = Element.OverrideInView(element=filterByBoolMask_2.in, overrides=byProperties)

# group: Change Regulated Smoke Detectors Black
black = Custom[Color.Black [Clockwork]]()  # "Color.Black"; Returns the colour black.
boolean_5 = BoolSelector(false)
byProperties_2 = Revit.Filter.OverrideGraphicSettings.ByProperties(black, black, black, black, arg12=boolean_5)
overrideInView_2 = Element.OverrideInView(element=filterByBoolMask_2.out, overrides=byProperties_2)

# group: Draw 450 mm boundary - used for debugging purposes
code_block_14 = CodeBlock { 625; }
byCenterPointRadius = Circle.ByCenterPointRadius(centerPoint=location_2.points, radius=code_block_14)
